# Grasshopper definition test.gh (Grasshopper 1.0.7)
# plug-ins: Transfinite, LunchBox, MeshEdit Components

panel = Panel("132.191 109.775 3.38065 123.46 116.194 11.2296 108.597 127.461 21.0665 92.0275 137.526 13.0152 83.9708 142.896 8.24165")
panel_2 = Panel("83.9708 142.896 8.24165 56.2923 127.796 9.87244 24.0174 118.532 8.4064 -7.25685 116.377 5.19098")
panel_3 = Panel("0.019329 11.8409 8.48475 13.1342 12.0097 8.47983 51.8205 -2.19188 8.49852 58.3194 -57.8379 8.16055 55.7628 -90.3898 8.64392 53.9182 -100 8.47485")
panel_4 = Panel("100 -100 0 99.065 -68.6247 -0.632911 101.652 -15.9413 -0.711095 115.079 54.0322 1.48612 126.276 92.4937 3.66448 132.191 109.775 3.38065")
panel_5 = Panel("-7.25685 116.377 5.19098 -6.20675 98.9834 18.6448 -4.03982 64.015 31.614 -0.726455 28.2153 16.9218 0.019329 11.8409 8.48475")
panel_6 = Panel("53.9182 -100 8.47485 61.3858 -99.653 11.4727 79.049 -100.186 15.9436 93.0327 -100 7.21678 100 -100 0")
cluster = Cluster(pt=panel, K="0 0 0 0.545052 1 1 1")  # -> pt_3, K_2
cluster_2 = Cluster(pt=panel_2, K="0 0 0 1 1 1")  # -> pt_3, K_2
cluster_3 = Cluster(pt=panel_5, K="0 0 0 0.518535 1 1 1")  # -> pt_3, K_2
cluster_4 = Cluster(pt=panel_3, K="0 0 0 0.270352 0.795435 1 1 1")  # -> pt_3, K_2
cluster_5 = Cluster(pt=panel_6, K="0 0 0 0.482422 1 1 1")  # -> pt_3, K_2
cluster_6 = Cluster(pt=panel_4, K="0 0 0 0.437553 0.74263 1 1 1")  # -> pt_3, K_2
nurbcrv = NurbsCurvePWK(Points=flatten(cluster.pt_3), Knots=cluster.K_2)  # -> Curve, Length, Domain
nurbcrv_2 = NurbsCurvePWK(Points=flatten(cluster_2.pt_3), Knots=cluster_2.K_2)  # -> Curve, Length, Domain
nurbcrv_3 = NurbsCurvePWK(Points=flatten(cluster_3.pt_3), Knots=cluster_3.K_2)  # -> Curve, Length, Domain
nurbcrv_4 = NurbsCurvePWK(Points=flatten(cluster_4.pt_3), Knots=cluster_4.K_2)  # -> Curve, Length, Domain
nurbcrv_5 = NurbsCurvePWK(Points=flatten(cluster_5.pt_3), Knots=cluster_5.K_2)  # -> Curve, Length, Domain
nurbcrv_6 = NurbsCurvePWK(Points=flatten(cluster_6.pt_3), Knots=cluster_6.K_2)  # -> Curve, Length, Domain
shatter = Shatter(Curve=nurbcrv_4.Curve, Parameters="0.5")
flatten = FlattenTree(Tree=shatter, Path="{0;0}")
merge = Merge(
    Data1=nurbcrv.Curve,
    Data2=nurbcrv_2.Curve,
    Data3=nurbcrv_3.Curve,
    Data4=flatten,
    Data5=nurbcrv_5.Curve,
    Data6=nurbcrv_6.Curve)

pt = Point(Point(0, 0, 0))
pt_2 = Point(Point(2, 0, 0))
pt_3 = Point(Point(2, 1, 0))
pt_4 = Point(Point(1, 1, 0))
pt_5 = Point(Point(1, 1, 0))
pt_6 = Point(Point(1, 2, 0))
pt_7 = Point(Point(1, 2, 0))
pt_8 = Point(Point(0, 0, 0))
pt_9 = Point(Point(2, 0, 0))
pt_10 = Point(Point(2, 1, 0))
pt_11 = Point(Point(0, 2, 0))
pt_12 = Point(Point(0, 2, 0))
panel_7 = Panel(pt)
panel_8 = Panel(pt_9)
panel_9 = Panel(pt_2)
panel_10 = Panel(pt_10)
panel_11 = Panel(pt_3)
panel_12 = Panel(pt_4)
panel_13 = Panel(pt_5)
panel_14 = Panel(pt_6)
panel_15 = Panel(pt_7)
panel_16 = Panel(pt_11)
panel_17 = Panel(pt_12)
panel_18 = Panel(pt_8)
ln = Line(StartPoint=panel_7, EndPoint=panel_8)
ln_2 = Line(StartPoint=panel_9, EndPoint=panel_10)
ln_3 = Line(StartPoint=panel_11, EndPoint=panel_12)
ln_4 = Line(StartPoint=panel_13, EndPoint=panel_14)
ln_5 = Line(StartPoint=panel_15, EndPoint=panel_16)
ln_6 = Line(StartPoint=panel_17, EndPoint=panel_18)
cluster_7 = Cluster_4(C=ln)
cluster_8 = Cluster_4(C=ln_2)
cluster_9 = Cluster_4(C=ln_3)
cluster_10 = Cluster_4(C=ln_4)
cluster_11 = Cluster_4(C=ln_5)
cluster_12 = Cluster_4(C=ln_6)
crv = Curve(cluster_7)
crv_2 = Curve(cluster_8)
crv_3 = Curve(cluster_9)
crv_4 = Curve(cluster_10)
crv_5 = Curve(cluster_11)
crv_6 = Curve(cluster_12)
merge_2 = Merge(Data1=crv, Data2=crv_2, Data3=crv_3, Data4=crv_4, Data5=crv_5, Data6=crv_6)  # -> flatten(Result)

flip = FlipCurve(Curve=crv_3)  # -> Curve, Flag
list = ValueList({"Salvi Shape": 0, "L Shape (seperate)": 1, "L Shape (merged)": 2}, selected="Salvi Shape")
list_2 = ValueList({"Harmonic Point": 3, "Radial Distance Function": 4}, selected="Harmonic Point")
list_3 = ValueList({"Special Side Blending": 2}, selected="Special Side Blending")
list_4 = ValueList({"Regular Domain": 0, "Concave Domain": 1}, selected="Concave Domain")

panel_19 = Panel("132.191 109.775 3.38065 123.46 116.194 11.2296 108.597 127.461 21.0665 92.0275 137.526 13.0152 83.9708 142.896 8.24165")  # disabled
panel_20 = Panel("83.9708 142.896 8.24165 56.2923 127.796 9.87244 24.0174 118.532 8.4064 -7.25685 116.377 5.19098")  # disabled
panel_21 = Panel("100 -100 0 99.065 -68.6247 -0.632911 101.652 -15.9413 -0.711095 115.079 54.0322 1.48612 126.276 92.4937 3.66448 132.191 109.775 3.38065")  # disabled
panel_22 = Panel("0.019329 11.8409 8.48475 13.1342 12.0097 8.47983 51.8205 -2.19188 8.49852 58.3194 -57.8379 8.16055 55.7628 -90.3898 8.64392 53.9182 -100 8.47485")  # disabled
panel_23 = Panel("-7.25685 116.377 5.19098 -6.20675 98.9834 18.6448 -4.03982 64.015 31.614 -0.726455 28.2153 16.9218 0.019329 11.8409 8.48475")  # disabled
panel_24 = Panel("53.9182 -100 8.47485 61.3858 -99.653 11.4727 79.049 -100.186 15.9436 93.0327 -100 7.21678 100 -100 0")  # disabled
panel_25 = Panel("0 0 0 0.437553 0.74263 1 1 1")  # disabled
panel_26 = Panel("0 0 0 0.270352 0.795435 1 1 1")  # disabled
panel_27 = Panel("0 0 0 0.482422 1 1 1")  # disabled
panel_28 = Panel("0 0 0 0.545052 1 1 1")  # disabled
panel_29 = Panel("0 0 0 1 1 1")  # disabled
panel_30 = Panel("0 0 0 0.518535 1 1 1")  # disabled
cluster_13 = Cluster(pt=panel_19, K=panel_28)  # -> pt_3, K_2; disabled
cluster_14 = Cluster(pt=panel_20, K=panel_29)  # -> pt_3, K_2; disabled
cluster_15 = Cluster(pt=panel_23, K=panel_30)  # -> pt_3, K_2; disabled
cluster_16 = Cluster(pt=panel_22, K=panel_26)  # -> pt_3, K_2; disabled
cluster_17 = Cluster(pt=panel_24, K=panel_27)  # -> pt_3, K_2; disabled
cluster_18 = Cluster(pt=panel_21, K=panel_25)  # -> pt_3, K_2; disabled
nurbcrv_7 = NurbsCurvePWK(Points=flatten(cluster_13.pt_3), Knots=cluster_13.K_2)  # -> Curve, Length, Domain; disabled
nurbcrv_8 = NurbsCurvePWK(Points=flatten(cluster_14.pt_3), Knots=cluster_14.K_2)  # -> Curve, Length, Domain; disabled
nurbcrv_9 = NurbsCurvePWK(Points=flatten(cluster_15.pt_3), Knots=cluster_15.K_2)  # -> Curve, Length, Domain; disabled
nurbcrv_10 = NurbsCurvePWK(Points=flatten(cluster_16.pt_3), Knots=cluster_16.K_2)  # -> Curve, Length, Domain; disabled
nurbcrv_11 = NurbsCurvePWK(Points=flatten(cluster_17.pt_3), Knots=cluster_17.K_2)  # -> Curve, Length, Domain; disabled
nurbcrv_12 = NurbsCurvePWK(Points=flatten(cluster_18.pt_3), Knots=cluster_18.K_2)  # -> Curve, Length, Domain; disabled
panel_31 = Panel("0.5")  # disabled
shatter_2 = Shatter(Curve=nurbcrv_10.Curve, Parameters=panel_31)  # disabled
flatten_2 = FlattenTree(Tree=shatter_2, Path="{0;0}")  # disabled
merge_3 = Merge(
    Data1=nurbcrv_7.Curve,
    Data2=nurbcrv_8.Curve,
    Data3=nurbcrv_9.Curve,
    Data4=nurbcrv_10.Curve,
    Data5=nurbcrv_11.Curve,
    Data6=nurbcrv_12.Curve)  # disabled

panel_32 = Panel("132.191 109.775 3.38065 123.46 116.194 11.2296 108.597 127.461 21.0665 92.0275 137.526 13.0152 83.9708 142.896 8.24165")  # disabled
panel_33 = Panel("83.9708 142.896 8.24165 56.2923 127.796 9.87244 24.0174 118.532 8.4064 -7.25685 116.377 5.19098")  # disabled
panel_34 = Panel("100 -100 0 99.065 -68.6247 -0.632911 101.652 -15.9413 -0.711095 115.079 54.0322 1.48612 126.276 92.4937 3.66448 132.191 109.775 3.38065")  # disabled
panel_35 = Panel("0.019329 11.8409 8.48475 13.1342 12.0097 8.47983 51.8205 -2.19188 8.49852 58.3194 -57.8379 8.16055 55.7628 -90.3898 8.64392 53.9182 -100 8.47485")  # disabled
panel_36 = Panel("-7.25685 116.377 5.19098 -6.20675 98.9834 18.6448 -4.03982 64.015 31.614 -0.726455 28.2153 16.9218 0.019329 11.8409 8.48475")  # disabled
panel_37 = Panel("53.9182 -100 8.47485 61.3858 -99.653 11.4727 79.049 -100.186 15.9436 93.0327 -100 7.21678 100 -100 0")  # disabled
panel_38 = Panel("0 0 0 0.270352 0.795435 1 1 1")  # disabled
panel_39 = Panel("0 0 0 0.482422 1 1 1")  # disabled
panel_40 = Panel("0 0 0 0.437553 0.74263 1 1 1")  # disabled
panel_41 = Panel("0 0 0 0.545052 1 1 1")  # disabled
panel_42 = Panel("0 0 0 1 1 1")  # disabled
panel_43 = Panel("0 0 0 0.518535 1 1 1")  # disabled
cluster_19 = Cluster_3(T=panel_32, K=panel_41)  # -> pt_2, R; disabled
cluster_20 = Cluster_3(T=panel_33, K=panel_42)  # -> pt_2, R; disabled
cluster_21 = Cluster_3(T=panel_36, K=panel_43)  # -> pt_2, R; disabled
cluster_22 = Cluster_3(T=panel_35, K=panel_38)  # -> pt_2, R; disabled
cluster_23 = Cluster_3(T=panel_37, K=panel_39)  # -> pt_2, R; disabled
cluster_24 = Cluster_3(T=panel_34, K=panel_40)  # -> pt_2, R; disabled
nurbcrv_13 = NurbsCurvePWK(Points=flatten(cluster_19.pt_2), Knots=cluster_19.R)  # -> Curve, Length, Domain; disabled
nurbcrv_14 = NurbsCurvePWK(Points=flatten(cluster_20.pt_2), Knots=cluster_20.R)  # -> Curve, Length, Domain; disabled
nurbcrv_15 = NurbsCurvePWK(Points=flatten(cluster_21.pt_2), Knots=cluster_21.R)  # -> Curve, Length, Domain; disabled
nurbcrv_16 = NurbsCurvePWK(Points=flatten(cluster_22.pt_2), Knots=cluster_22.R)  # -> Curve, Length, Domain; disabled
nurbcrv_17 = NurbsCurvePWK(Points=flatten(cluster_23.pt_2), Knots=cluster_23.R)  # -> Curve, Length, Domain; disabled
nurbcrv_18 = NurbsCurvePWK(Points=flatten(cluster_24.pt_2), Knots=cluster_24.R)  # -> Curve, Length, Domain; disabled
panel_44 = Panel("0.5")  # disabled
shatter_3 = Shatter(Curve=nurbcrv_16.Curve, Parameters=panel_44)  # disabled
flatten_3 = FlattenTree(Tree=shatter_3, Path="{0;0}")  # disabled
merge_4 = Merge(
    Data1=nurbcrv_13.Curve,
    Data2=nurbcrv_14.Curve,
    Data3=nurbcrv_15.Curve,
    Data4=flatten_3,
    Data5=nurbcrv_17.Curve,
    Data6=nurbcrv_18.Curve)  # disabled

pt_13 = Point(Point(0, 0, 0))
pt_14 = Point(Point(2, 0, 0))
pt_15 = Point(Point(2, 1, 0))
pt_16 = Point(Point(1, 1, 0))
pt_17 = Point(Point(1, 2, 0))
pt_18 = Point(Point(1, 2, 0))
pt_19 = Point(Point(0, 0, 0))
pt_20 = Point(Point(2, 0, 0))
pt_21 = Point(Point(2, 1, 0))
pt_22 = Point(Point(1, 1, 0))
pt_23 = Point(Point(0, 2, 0))
pt_24 = Point(Point(0, 2, 0))
panel_45 = Panel(pt_20)
panel_46 = Panel(pt_14)
panel_47 = Panel(pt_21)
panel_48 = Panel(pt_15)
panel_49 = Panel(pt_16)
panel_50 = Panel(pt_22)
panel_51 = Panel(pt_17)
panel_52 = Panel(pt_18)
panel_53 = Panel(pt_23)
panel_54 = Panel(pt_24)
panel_55 = Panel(pt_19)
panel_56 = Panel(pt_13)
ln_7 = Line(StartPoint=panel_56, EndPoint=panel_45)
ln_8 = Line(StartPoint=panel_46, EndPoint=panel_47)
ln_9 = Line(StartPoint=panel_48, EndPoint=panel_49)
ln_10 = Line(StartPoint=panel_50, EndPoint=panel_51)
ln_11 = Line(StartPoint=panel_52, EndPoint=panel_53)
ln_12 = Line(StartPoint=panel_54, EndPoint=panel_55)
cluster_25 = Cluster_4(C=ln_7)
cluster_26 = Cluster_4(C=ln_8)
cluster_27 = Cluster_4(C=ln_9)
cluster_28 = Cluster_4(C=ln_10)
cluster_29 = Cluster_4(C=ln_11)
cluster_30 = Cluster_4(C=ln_12)
crv_7 = Curve(cluster_26)
crv_8 = Curve(cluster_28)
crv_9 = Curve(cluster_29)
crv_10 = Curve(cluster_25)
crv_11 = Curve(cluster_27)
crv_12 = Curve(cluster_30)

join = JoinCurves(Curves=[crv_11, crv_8], Preserve=False)
flatten_4 = FlattenTree(Tree=join, Path="{0}")

merge_5 = Merge(Data1=crv_10, Data2=crv_7, Data3=flatten_4, Data4=crv_9, Data5=crv_12)

filter = StreamFilter(Gate=list, Stream0=merge, Stream1=merge_2, Stream2=merge_5)
project = Project(Geometry=filter, Plane=PlaneXY(0, 0, 0))  # -> Geometry, Transform

number_slider = Slider(500, range=0..1000)
patch = PatchSurface(EdgeCurves=project.Geometry, U=2, V=2, Tolerance=0.001)
qrsettings = QuadRemeshSettings(
    TargetCount=Slider(10000, range=0..10000),
    AdaptiveSize=0,
    AdaptiveCount=False,
    HardEdges=invert(False),
    SeamEdges=0,
    Symmetry=0,
    GuideCurves=0)
qrmesh = QuadRemesh(Mesh=patch, Settings=qrsettings)

crv_13 = Curve(filter)
cluster_31 = Cluster_2(C=filter)  # -> O, R
neg = Negative(Value=cluster_31.R)
medges = MeshEdges(Mesh=qrmesh)  # -> NakedEdges, InteriorEdges, NonManifoldEdges
transfinite = TransfiniteSurface(Curves=filter, DomainType=list_4, Parametrization=list_2, Blending=list_3, Mesh=qrmesh)  # -> Model, DomainC, DomainV, DomainMesh, RibbonVector, RibbonCenter, RibbonVector_2
vdis = VectorDisplay(Anchor=cluster_31.O, Vector=neg)
nakededge = MeshNakedEdge(Mesh=qrmesh)  # -> V, A, B

nickname = RibbonTest(Curves=filter)  # -> M, M2, Rc, Rv
pt_25 = Point(nickname.Rc)
medges_2 = MeshEdges(Mesh=nickname.M)  # -> NakedEdges, InteriorEdges, NonManifoldEdges
swatch = ColourSwatch(SwatchColor=RGB(255, 31, 31))
vdis_2 = VectorDisplay(Anchor=pt_25, Vector=nickname.Rv)
demesh = DeconstructMesh(Mesh=nickname.M)  # -> Vertices, Faces, Colours, Normals
demesh_2 = DeconstructMesh(Mesh=nickname.M2)  # -> Vertices, Faces, Colours, Normals
conmesh = ConstructMesh(Vertices=demesh_2.Vertices, Faces=demesh_2.Faces)
conmesh_2 = ConstructMesh(Vertices=demesh.Vertices, Faces=demesh.Faces, Colours=ColourSwatch(SwatchColor=RGB(2, 101, 250)))

line = Line(medges.NakedEdges)

demesh_3 = DeconstructMesh(Mesh=transfinite.Model)  # -> Vertices, Faces, Colours, Normals
conmesh_3 = ConstructMesh(Vertices=demesh_3.Vertices, Faces=demesh_3.Faces)
preview = CustomPreview(Geometry=conmesh_3, Material=ColourSwatch(SwatchColor=RGB(0, 255, 0)))
medges_3 = MeshEdges(Mesh=conmesh_3)  # -> NakedEdges, InteriorEdges, NonManifoldEdges

item = ListItem(List=nakededge.V, Index=nakededge.B, Wrap=True)
medges_4 = MeshEdges(Mesh=transfinite.DomainMesh)  # -> NakedEdges, InteriorEdges, NonManifoldEdges

# ==== cluster Cluster
K = ClusterInput()  # K
pt = ClusterInput()  # Pt
split = TextSplit(Text=pt, Separators=" ")
split_2 = TextSplit(Text=K, Separators=" ")
partition = PartitionList(List=split, Size=3)
item = ListItem(List=partition, Index=0, Wrap=True)  # -> Item, Item1, Item2
pt_2 = ConstructPoint(XCoordinate=item.Item, YCoordinate=item.Item1, ZCoordinate=item.Item2)
K_2 = ClusterOutput(split_2)  # K
pt_3 = ClusterOutput(pt_2)  # Pt

# ==== cluster Cluster_2
C = ClusterInput()
range = Range(Domain=Domain(0, 1), Steps=Slider(20, range=0..100))
hframe = HorizontalFrame()
cdiv = Derivatives(Curve=reparameterize(graft(C)), Parameter=range)  # -> Point, FirstDerivative
pframe = PerpFrame(Curve=reparameterize(graft(C)), Parameter=range)
pl = PlaneNormal(Origin=cdiv.Point, ZAxis=cdiv.FirstDerivative)
deplane = DeconstructPlane(Plane=pframe)  # -> Origin, XAxis, YAxis, ZAxis
multiplication = Multiplication(A=deplane.XAxis, B=Slider(50, range=0..100))
vdis = VectorDisplay(Anchor=deplane.Origin, Vector=multiplication)
R = ClusterOutput(multiplication)
O = ClusterOutput(deplane.Origin)

# ==== cluster Cluster_3
T = ClusterInput()
K = ClusterInput()  # K
split = TextSplit(Text=T, Separators=" ")
split_2 = TextSplit(Text=K, Separators=" ")
partition = PartitionList(List=split, Size=3)
R = ClusterOutput(split_2)
item = ListItem(List=partition, Index=0, Wrap=True)  # -> Item, Item1, Item2
pt = ConstructPoint(XCoordinate=item.Item, YCoordinate=item.Item1, ZCoordinate=Slider(0, range=0..100))
pt_2 = ClusterOutput(pt)

# ==== cluster Cluster_4
C = ClusterInput()
reb = RebuildCurve(Curve=C, Degree=Slider(3, range=0..10), Count=Slider(4, range=0..10), Tangents=False)
C_2 = ClusterOutput(reb)
